# Grasshopper definition MPDA20_AT-APY-03-geo-dir.gh (Grasshopper 1.0.7)
# plug-ins: MeshEdit Components, LunchBox, Kangaroo2 Components

data = Data(Point(-0.03009384491, 17.66608989, 1.278900258))  # disabled
data_2 = Data(Point(-0.1137661387, 16.98154073, 1.585349973))  # disabled
data_3 = Data(Point(-0.1476539521, 16.65329523, 1.527120745))  # disabled
data_4 = Data(Point(-0.06365214303, 17.26381502, 1.225409536))  # disabled
c_script = CSharpScript()  # -> out, A; inputs M: Mesh; disabled
# ---------- c_script: C# usings ----------
using System.Drawing;
# ---------- c_script: C# ----------
    
      Mesh destination1 = M;
      bool destination2 = false;

      List<Mesh> meshList = new List<Mesh>(destination1.Faces.Count);
    
      for (int index1 = 0; index1 < destination1.Faces.Count; ++index1)
      {
        Mesh mesh = new Mesh();
        List<Color> colorList = new List<Color>();
        MeshFace face = destination1.Faces.GetFace(index1);
        int a1 = face.A;
        face = destination1.Faces.GetFace(index1);
        int b1 = face.B;
        face = destination1.Faces.GetFace(index1);
        int c = face.C;
        mesh.Vertices.Add(destination1.Vertices[a1]);
        mesh.Vertices.Add(destination1.Vertices[b1]);
        mesh.Vertices.Add(destination1.Vertices[c]);
        if (destination1.VertexColors.Count != 0)
        {
          colorList.Add(destination1.VertexColors[a1]);
          colorList.Add(destination1.VertexColors[b1]);
          colorList.Add(destination1.VertexColors[c]);
        }
        face = destination1.Faces.GetFace(index1);
        if (face.IsTriangle)
        {
          mesh.Faces.AddFace(0, 1, 2);
        }
        else
        {
          face = destination1.Faces.GetFace(index1);
          int d = face.D;
          mesh.Vertices.Add(destination1.Vertices[d]);
          if (destination1.VertexColors.Count != 0)
            colorList.Add(destination1.VertexColors[d]);
          mesh.Faces.AddFace(0, 1, 2, 3);
        }
        if (destination1.VertexColors.Count != 0)
        {
          if (!destination2)
          {
            mesh.VertexColors.AppendColors(colorList.ToArray());
          }
          else
          {
            int num1 = 0;
            int num2 = 0;
            int num3 = 0;
            int num4 = 0;
            for (int index2 = 0; index2 < colorList.Count; ++index2)
            {
              int num5 = num1;
              Color color = colorList[index2];
              int a2 = (int) color.A;
              num1 = num5 + a2;
              int num6 = num2;
              color = colorList[index2];
              int r = (int) color.R;
              num2 = num6 + r;
              int num7 = num3;
              color = colorList[index2];
              int g = (int) color.G;
              num3 = num7 + g;
              int num8 = num4;
              color = colorList[index2];
              int b2 = (int) color.B;
              num4 = num8 + b2;
            }
            Color baseColor = Color.FromArgb(num1 / colorList.Count, num2 / colorList.Count, num3 / colorList.Count, num4 / colorList.Count);
            mesh.VertexColors.CreateMonotoneMesh(baseColor);
          }
        }
        meshList.Add(mesh);
      }
    A = meshList;
# ---------- end c_script ----------
enneper = EnneperSurface(UDivisions=100, VDivisions=100, RParameter=3, Scale=15, Domain1=Domain(0, 1), Domain2=Domain(-3.141592654, 3.141592654))
mesh = Mesh(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)
meshcp = MeshClosestPoint(Point=[data, data_3, data_2, data_4], Mesh=mesh)  # -> Point, Index, Parameter; disabled
geomesh = Data([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])
startvec = Data(Vector(-0.04282581297, -0.9448270374, 0.3247580933))
startpt = Data(Point(0.01256512785, 18.20114455, 1.059943801))
samplemesh = Data([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])
python = GhPythonScript(mesh=mesh, t=Slider(0.005, range=0..1), rot=Slider(-1.24, range=-2..3), iter=Slider(100, range=1..100))  # -> out, b, e, f, g, i, j; inputs mesh: Mesh, iter: Int32
# ---------- python: Python ----------
import Rhino.Geometry as rg


def meshFaceToMesh(mesh, faceIndex):
    """This function returns a new mesh from a mesh and a faceIndex"""
    m = rg.Mesh()
    for v in mesh.Faces.GetFaceVertices(faceIndex)[1:]:
        m.Vertices.Add(v)
    m.Faces.AddFace(0,1,2)
    return m
    



#######gets naked edge polyline from mesh

mesh.Normals.ComputeNormals() #always compute normals first

#gets naked edge polyline from mesh
mEdge = rg.Mesh.GetNakedEdges(mesh)
mEdgeItem = mEdge[0]

#transform polyline to NurbsCurve, in order to evaluate
mEdgeCrv = mEdgeItem.ToNurbsCurve()

#reparametrize curve
mEdgeCrv.Domain = rg.Interval(0,1)

#evaluate the curve
startPt = mEdgeCrv.PointAt(t)



######## get face closest to the point (index)

#get the face closest to our startPoint
mP = mesh.ClosestMeshPoint(startPt, 0.0)
faceIndex = mP.FaceIndex
firstMesh= meshFaceToMesh(mesh, faceIndex) #get the mesh closest to the point


#make an empty new mesh
geodesicMesh= rg.Mesh()

#add the first mesh
geodesicMesh.Append(firstMesh)


#start lists where we will store the values in each iteration
geoFaces= [faceIndex] #this list starts with the first faceIndex already in it
geoPts = [startPt] #this list starts with the start point already in it
geoPlanes = []
geoVecs = []


#####make start vector (from the starting point and the plane of the initial face) to define direction
norm = mesh.FaceNormals[geoFaces[-1]]
initialPlane = rg.Plane(geoPts[-1],norm)
initialPlane.Transform(rg.Transform.Rotation(rot, norm, geoPts[-1]))
geoPlanes.append(initialPlane)
sVec = initialPlane.YAxis 
geoVecs.append(sVec)



#count how many times do we encounter faces with only two neighbors (one at the beginning and one at the end)
count = 0 #WHILE LOOP

#we use a while loop instead of a for loop, so that we can escape with a condition, in this case, when the count is more than two (line 62)
#while count<2: #WHILE LOOP

for i in range(iter):
    #gets the face from the mesh using the index
    adjFaces = mesh.Faces.AdjacentFaces(geoFaces[-1])

    #check if the face has only two neighbors, then we add one to the counter
    #if len(adjFaces)==2: count +=1 #WHILE LOOP
    
    ######if the counter is more than two, we can escape the while loop
    #####if count >=2: break #WHILE LOOP


    #make a plane to define the direction of intersection
    intersectionPlane = rg.Plane(geoPlanes[-1])
    intersectionPlane.Transform(rg.Transform.Rotation(3.14/2, intersectionPlane.YAxis, intersectionPlane.Origin))

    #iterate through all the adjacent faces
    for adj in adjFaces:
        #make a new mesh from the adj faces
        newMesh = meshFaceToMesh(mesh, adj)
        
        #intersect our plane with the new mesh
        mpx = rg.Intersect.Intersection.MeshPlane(newMesh, intersectionPlane)

        #if the intersection exists, and the face is not in the geoFaces list, we continue
        if mpx and adj not in geoFaces:
            
            geodesicMesh.Append(newMesh) #append the new mesh to the geodesicMesh
            newStartPt = mpx[0].ClosestPoint(geoPts[-1]) #get the new start point 
            geoFaces.append(adj) #append the face number
            geoPts.append(newStartPt) #append the new start point
            newPlane = rg.Plane(geoPlanes[-1]) #create a new plane copying the last plane
            newPlane.Origin = newStartPt #move the plane to the new starting point
            angle = rg.Vector3d.VectorAngle(mesh.FaceNormals[adj],newPlane.ZAxis) #measure the angle between the normal of old plane and the new plane
            axis = rg.Vector3d.CrossProduct(newPlane.ZAxis,mesh.FaceNormals[adj]) #get the crossvector for rotation axis
            newPlane.Transform(rg.Transform.Rotation(angle, axis, newPlane.Origin)) #rotate the plane in that axis
            geoPlanes.append(newPlane) #append the plane as a new plane 
            geoVecs.append(newPlane.YAxis) #append the new direction vector (only to display)

#output parameters of our python component
b = startPt
e = geoPts
f = geoVecs
g = geoFaces
i = geoPlanes
j = geodesicMesh
# ---------- end python ----------
mesh_2 = Data(samplemesh)
item = ListItem(List=mesh_2, Index=0, Wrap=True)
faceb = FaceBoundaries(Mesh=item)
eval = EvaluateCurve(Curve=reparameterize(faceb), Parameter=Slider(0.52, range=0..1))  # -> Point, Tangent, Angle
startpt_2 = Data(eval.Point)
explode = MeshExplode(Mesh=mesh, Interpolate=False)
geodesic_planes = Data(python.i)
geodesic_mesh = Data(python.j)
start_point = Data(python.b)
item_2 = ListItem(List=python.e, Index=0, Wrap=True)  # -> Item1, Item
vdis = VectorDisplay(Anchor=python.e, Vector=python.f)
preview = CustomPreview(Geometry=mesh, Material=ColourSwatch(SwatchColor=RGBA(153, 153, 153, 40)))
data_5 = Data(item)
facen = FaceNormals(Mesh=data_5)  # -> Centers, Normals
unroller = Unroller(Strip=geodesic_mesh, Unroll=1)
item_3 = ListItem(List=explode, Index=python.g, Wrap=True)
geodesic = Geodesic(Surface=enneper, Start=item_2.Item1, End=item_2.Item)
pl = PlaneNormal(Origin=facen.Centers, ZAxis=facen.Normals)
pl_origin = PlaneOrigin(Base=pl, Origin=startpt_2)
move = Move(Geometry=unroller, Motion=Vector(0, 0, 10))  # -> Geometry, Transform
prot = RotatePlane(Plane=pl_origin, Angle=Slider(3.26, range=0..10))
deplane = DeconstructPlane(Plane=prot)  # -> Origin, XAxis, YAxis, ZAxis
rot3d = Rotate3D(Geometry=prot, Angle=1.570796327, Center=startpt_2, Axis=deplane.XAxis)  # -> Geometry, Transform

# ---- group: get adjacent
item_4 = ListItem(List=mesh_2, Index=0, Wrap=True)  # -> Item, Item1

# ----
vdis_2 = VectorDisplay(Anchor=prot, Vector=deplane.XAxis)
sec = MeshPlane(Mesh=item_4.Item1, Plane=rot3d.Geometry)
end = EndPoints(Curve=sec)  # -> Start, End
merge = Merge(Data1=end.Start, Data2=end.End)
meshcp_2 = MeshClosestPoint(Point=merge, Mesh=item_4.Item1)  # -> Point, Index, Parameter
dist = Distance(PointA=facen.Centers, PointB=meshcp_2.Point)
sort = SortList(Keys=dist, ValuesA=merge)  # -> Keys, ValuesA
item_5 = ListItem(List=sort.ValuesA, Index=0, Wrap=True)  # -> Item1, Item
closestpt = Data(item_5.Item)
facen_2 = FaceNormals(Mesh=item_4.Item1)  # -> Centers, Normals
pl_origin_2 = PlaneOrigin(Base=prot, Origin=closestpt)
deplane_2 = DeconstructPlane(Plane=pl_origin_2)  # -> Origin, XAxis, YAxis, ZAxis
angle = Angle(VectorA=facen_2.Normals, VectorB=deplane_2.ZAxis)  # -> Angle, Reflex
xprod = CrossProduct(VectorA=deplane_2.ZAxis, VectorB=facen_2.Normals, Unitize=False)  # -> Vector, Length
vdis_3 = VectorDisplay(Anchor=deplane_2.Origin, Vector=xprod.Vector)
rot3d_2 = Rotate3D(Geometry=pl_origin_2, Angle=angle.Angle, Center=deplane_2.Origin, Axis=xprod.Vector)  # -> Geometry, Transform
deplane_3 = DeconstructPlane(Plane=rot3d_2.Geometry)  # -> Origin, XAxis, YAxis, ZAxis
vdis_4 = VectorDisplay(Anchor=rot3d_2.Geometry, Vector=deplane_3.XAxis)
