# Grasshopper definition MPDA20_AT-APY-03-geo2pt.gh (Grasshopper 1.0.7)
# plug-ins: Human, Kangaroo Components, LunchBox, plankton

# ----
# 0.MAKE A SURFACE
enneper = EnneperSurface(UDivisions=100, VDivisions=100, RParameter=3, Scale=15, Domain1=Domain(0, 1), Domain2=Domain(-3.141592654, 3.141592654))

surface = Surface(enneper)

# ----
# 1. EVALUATE SURFACE IN TWO POINTS
number_slider = Slider(1, range=0..1)
pt = ConstructPoint(XCoordinate=Slider(1, range=0..1), YCoordinate=Slider(1, range=0..1), ZCoordinate=0)
pt_2 = ConstructPoint(XCoordinate=number_slider, YCoordinate=Slider(0.61, range=0..1), ZCoordinate=0)
evalsrf = EvaluateSurface(Surface=reparameterize(surface), Point=pt)  # -> Point, Normal, Frame
evalsrf_2 = EvaluateSurface(Surface=reparameterize(surface), Point=pt_2)  # -> Point, Normal, Frame

# ----
# 2. DISCRETIZE
number_slider_2 = Slider(0.64, range=0.15..3)
timer = Timer(TimerInterval=20, Target=meshmachine)  # disabled
edges = BrepEdges(Brep=surface)  # -> Naked, Interior, NonManifold
meshmachine = MeshMachine(
    Geometry=surface,
    Length=number_slider_2,
    FixCurves=edges.Naked,
    Flip=1,
    PullStrength=0.8,
    CurvatureAdaptivity=0,
    BoundaryScale=1,
    BoundaryDistance=5,
    Exponent=2,
    Background=0.5,
    Iterations=1,
    Reset=Toggle(False))
pmesh = PlanktonMesh(meshmachine)

mesh = Mesh(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)

# ---- group: ghcomplib
# 3. ITERATE
number_slider_3 = Slider(59, range=0..110)
point1 = Data(evalsrf.Point)
point2 = Data(evalsrf_2.Point)
mesh_2 = Mesh(mesh)
geodraft = PythonScript(Mesh=mesh_2, A=point1, B=point2, sub=number_slider_3, iter=Slider(8, range=0..100))  # -> out, outputPoints; inputs Mesh: Mesh, A: Point3d, B: Point3d, sub: Int32, iter: Int32
# ---------- geodraft: Python ----------
import ghpythonlib.components as ghc

#make a line from two points
initialLine = ghc.Line(A, B)

#subdivide the line
divideLine = ghc.DivideCurve(initialLine, sub, False)

#get the first output of the component
divideLinePts = divideLine[0]


avgPtList = []
for j in range(iter):
    for i in range(1,sub):
        #find average points
        avgPt = (divideLinePts[i-1]+divideLinePts[i+1]) / 2
        
        #pull the average point to mesh
        newPtOnMesh = ghc.MeshClosestPoint(avgPt, Mesh)
        newPtOnMeshOnlyPoints = newPtOnMesh[0]
        
        #replace the point in the list
        divideLinePts = ghc.ReplaceItems(divideLinePts, newPtOnMeshOnlyPoints, i, True)

#make a polyline with points
poly = ghc.PolyLine(divideLinePts, False)


#output the list of points to GH
outputPoints = poly
# ---------- end geodraft ----------
preview = CustomPreview(Geometry=mesh_2, Shader=ColourSwatch(SwatchColor=RGBA(82, 82, 82, 25)))
previewlw = CustomPreviewLineweights(
    Geometry=geodraft.outputPoints,
    Shader={diffuse=RGB(255, 105, 180), emission=RGB(76, 32, 54), shine=0.5, specular=RGB(255, 255, 255), transparency=0},
    Thickness=Slider(6.2, range=0..10),
    Absolute=False)
