# Grasshopper definition MPDA20_AT-APY-03-geo2pt_setup_.gh (Grasshopper 1.0.7)

surface = Surface(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)
pt = ConstructPoint(XCoordinate=Slider(1, range=0..1), YCoordinate=Slider(1, range=0..1), ZCoordinate=0)
pt_2 = ConstructPoint(XCoordinate=Slider(1, range=0..1), YCoordinate=Slider(0.61, range=0..1), ZCoordinate=0)
evalsrf = EvaluateSurface(Surface=reparameterize(surface), Point=pt)  # -> Point, Normal, Frame
evalsrf_2 = EvaluateSurface(Surface=reparameterize(surface), Point=pt_2)  # -> Point, Normal, Frame
point2 = Point(evalsrf_2.Point)
mesh = Mesh(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)
point1 = Point(evalsrf.Point)
python = GhPythonScript()  # -> Out, A
