# Grasshopper definition MPDA02_session04_K2_scripting.gh (Grasshopper 1.0.7)
# plug-ins: Kangaroo2 Components

number_slider = Slider(0.53, range=0..10)
mplane = MeshPlane(Boundary={Plane=PlaneXY(0, 0, 0), Size=Domain2(u=-10..10, v=-10..10)}, WidthCount=10, HeightCount=10)  # -> Mesh, Area
# K2 scripting + persistent data
button = Button()
geo = Geometry(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)
pt = Point([Point(24.01075897, 28.75663638, 0), Point(24.01075897, -22.27127449, 0), Point(33.82701709, -1.860110142, 0)])

# ---- group: enable!
timer = Timer(TimerInterval=20, Target=python)  # disabled

# ----
medges = MeshEdges(Mesh=mplane.Mesh)  # -> NakedEdges, InteriorEdges, NonManifoldEdges
mc = MeshCorners(Mesh=mplane.Mesh, Angle=2.35619449)
number_slider_2 = Slider(1, range=0..1)  # disabled
number_slider_3 = Slider(0.0101, range=0..0.1)  # disabled
number_slider_4 = Slider(21, range=0..100)  # disabled
python = GhPythonScript(reset=button, sPts=pt, target=geo, r=number_slider)  # -> out, a; inputs reset: Boolean, sPts: list of Point3d, target: Mesh
# ---------- python: Python ----------
import Rhino.Geometry as rg
import clr
clr.AddReferenceToFile("KangarooSolver.dll")
import KangarooSolver as ks
from System.Collections.Generic import List


if reset:
    #state1: something happens
    points = sPts
    
else: 
    #state2: something else happens
    
    #find the avg points
    avgPt = ks.Util.AveragePoint(List[rg.Point3d](points))
    points.append(avgPt)
    
    PS = ks.PhysicalSystem()
    GoalList = List[ks.IGoal]()
    
    G = [] #list of goals
    
    CollideGoal = ks.Goals.SphereCollide(List[rg.Point3d](points), r, 1)
    G.append(CollideGoal)
    
    OnMeshGoal = ks.Goals.OnMesh(List[rg.Point3d](points), target, 1)
    G.append(OnMeshGoal)
    
    for goal in G:
        
        PS.AssignPIndex(goal, 0.001)
        GoalList.Add(goal)
        
    PS.Step(GoalList, False, 0.001)
    points = list(PS.GetPositions())
    
a = points
# ---------- end python ----------
sph = Sphere(Base=python.a, Radius=number_slider)  # disabled
# K2 scripting
# 1. Geometry
# 2. Goals
number_slider_5 = Slider(0, range=0..10)
length_line = LengthLine(Line=[medges.NakedEdges, medges.InteriorEdges], Length=number_slider_5, Strength=10)
anchor = Anchor(Point=mc, Strength=10000)
bbx = BrepBrep(BrepA=geo, BrepB=sph)  # -> Curves, Points; disabled
msphere = MeshSphere(Base=python.a, Radius=number_slider, UCount=10, VCount=20)
python_2 = GhPythonScript(Line=[medges.NakedEdges, medges.InteriorEdges], Length=Slider(1, range=0..1), aPoints=mc)  # -> out, a; inputs Line: list of Line, aPoints: list of Point3d; disabled
# ---------- python_2: Python ----------
# 1. make sure that python component can see the library
# 2. refernce that library using CLR

import clr
clr.AddReferenceToFile("KangarooSolver.dll")
import KangarooSolver as ks

G = [] #list of goals

for l in Line:
    
    springGoal = ks.Goals.Spring(l, Length, 10.0)
    
    G.append(springGoal)

for p in aPoints:
    anchorGoal = ks.Goals.Anchor(p, 10000)
    G.append(anchorGoal)


a = G
# ---------- end python_2 ----------
python_3 = GhPythonScript(
    Line=[medges.NakedEdges, medges.InteriorEdges],
    k=number_slider_3,
    Length=number_slider_2,
    aPoints=mc,
    iter=number_slider_4)  # -> out, a, b; inputs Line: list of Line, aPoints: list of Point3d, iter: Int32; disabled
# ---------- python_3: Python ----------
import clr
clr.AddReferenceToFile("KangarooSolver.dll")
import KangarooSolver as ks

#bring C# list to python
from System.Collections.Generic import List


PS = ks.PhysicalSystem()
tol = 0.0001
GoalList = List[ks.IGoal]()


#GOALS ------------------------

G = [] #list of goals

for l in Line:
    
    springGoal = ks.Goals.Spring(l, Length, k)
    
    G.append(springGoal)

for p in aPoints:
    anchorGoal = ks.Goals.Anchor(p, 10000)
    G.append(anchorGoal)


#RUN ------------------------

#Goals = []
for g in G:
    PS.AssignPIndex(g, tol)
    #Goals.append(g)
    GoalList.Add(g)

for i in range(iter):
    PS.Step(GoalList, False, tol)




a = PS.GetOutput(GoalList)
b = PS.GetPositions()
# ---------- end python_3 ----------
meshes = Data([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])
loops = Data(Tree({0;0;0}: [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], {0;0;1}: [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], {0;0;2}: [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], {0;0;3}: [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], {0;0;4}: [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], {0;0;5}: [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]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))
data = Data(python_3.a)  # disabled
panel = Panel(length_line)
# 3. Solver
solver = Solver(GoalObjects=[length_line, anchor], Reset=Button(), Threshold=1e-15, Tolerance=0.01, On=True)  # -> I, V, O; disabled
solver_2 = Solver(GoalObjects=python_2.a, Reset=False, Threshold=1e-15, Tolerance=0.01, On=True)  # -> I, V, O; disabled
# 4. Geometry
data_2 = Data(solver.O)  # disabled
data_3 = Data(solver_2.O)  # disabled
