# Grasshopper definition MPDA02_session04_persistent.gh (Grasshopper 1.0.7)

number_slider = Slider(5, range=0..10)  # disabled
number_slider_2 = Slider(10, range=0..10)  # disabled
number_slider_3 = Slider(10, range=0..10)  # disabled
pt = ConstructPoint(XCoordinate=Slider(68, range=0..100), YCoordinate=0, ZCoordinate=0)
toggle = BooleanToggle(True)  # disabled
pt_2 = ConstructPoint(XCoordinate=0, YCoordinate=0, ZCoordinate=Slider(0, range=0..100))
planesrf = PlaneSurface(Plane=PlaneXY(0, 0, 0), XSize=Domain(-10, 10), YSize=number_slider)  # disabled
# persistent data
pt_3 = ConstructPoint(XCoordinate=0, YCoordinate=0, ZCoordinate=0)  # disabled
vec = VectorXYZ(XComponent=number_slider_3, YComponent=number_slider_2, ZComponent=0)  # -> Vector, Length; disabled
# sticky dictionary
python = GhPythonScript()  # -> out, a
# ---------- python: Python ----------
import Rhino.Geometry as rg
#what is dictionary?

#newlist = []
newlist = [1,2,3,4] #this is a list
print newlist[-1]


#newdict = dict()
newdict = {}

newdict["key1"] = 1000
newdict["key2"] = "Gerard"
newdict["key3"] = rg.Point3d(0,0,0)
newdict["key4"] = [1,2,3,4,5]


print newdict
a= newdict["key4"]
# ---------- end python ----------
timer = Timer(TimerInterval=50, Target=python_4)  # disabled

# ---- group: sender
python_2 = GhPythonScript(x=pt, y=pt_2)  # inputs x: Point3d, y: Point3d
# ---------- python_2: Python ----------
import scriptcontext as sc
import Rhino.Geometry as rg

print sc.sticky
print type(sc.sticky)

sc.sticky["point1"] = x
sc.sticky["point2"] = y
sc.sticky["line"] = rg.Line( x, y)

myDict = {}
myDict["a"] = 10 
myDict["b"] = 20 

sc.sticky["dict"] = myDict

print  sc.sticky["line"].Length
# ---------- end python_2 ----------

python_3 = GhPythonScript(x=planesrf)  # inputs x: Surface; disabled
# ---------- python_3: Python ----------
import scriptcontext as sc
import Rhino.Geometry as rg

print sc.sticky
print type(sc.sticky)

sc.sticky["srf"] = x
sc.sticky["srfPt"] = x.PointAt(0.5, 0.)
# ---------- end python_3 ----------

# ----
python_4 = GhPythonScript(reset=toggle, pt=pt_3, vec=vec.Vector)  # -> out, a; inputs reset: Boolean, pt: Point3d, vec: Vector3d; disabled
# ---------- python_4: Python ----------
#particle = pt
#particle = pt + vec
#
#for i in range(10):
#    particle = pt + vec * i
#    
#a  = particle

if reset:
    particle = pt
    
else:
    particle = particle + vec
    
a = particle
# ---------- end python_4 ----------
panel = Panel(python.a)
rec = DataRecorder(python_4.a, DataLimit=-10, RecordData=True)  # disabled

# ---- group: receiver
python_5 = GhPythonScript()  # -> out, a, b
# ---------- python_5: Python ----------
import scriptcontext as sc

print sc.sticky

line = sc.sticky["line"]

line2 = sc.sticky["line2"]

srf = sc.sticky["srf"] 
srfPt = sc.sticky["srfPt"]



a = line
b = [srf, srfPt]
# ---------- end python_5 ----------

# ----
panel_2 = Panel(rec)  # disabled
pline = PolyLine(Vertices=rec, Closed=False)  # disabled
panel_3 = Panel(python_5.a)
