# Grasshopper definition MPDA02_session05_K2_scripting.gh (Grasshopper 1.0.7)

pt = Point(Point(-3.43758872, 3, 0))
pt_2 = Point(Point(4, -1, 0))
pt_3 = Point(Point(4.990414373, 4.418517415, 0))
cir = Circle(Plane=[pt, pt_2, pt_3], Radius=Slider(5.31, range=0..10))
runion = RegionUnion(Curves=cir)
# iterating trees  in ghpython
series = Series(Start=0, Step=1, Count=10)

# ---- group: work with external file
# K2 scripting + persistent data
path = FilePath("C:\Users\david.leon\Desktop\sandbox.py")  # disabled
file = ReadFile(File=path, PerLineParse=False)  # disabled

# ----
reb = RebuildCurve(Curve=runion, Degree=Slider(0, range=0..100), Count=Slider(54, range=0..100), Tangents=False)
series_2 = Series(Start=series, Step=1, Count=10)  # -> simplify(Series)
python = GhPythonScript(reset=Button(), polylines=reb, z=Slider(2, range=0..10))  # -> out, A, B, C; inputs reset: Boolean, polylines: list of Polyline; disabled
# ---------- python: Python ----------
import clr
clr.AddReferenceToFile("kangarooSolver.dll")
import KangarooSolver as ks

from System.Collections.Generic import List
import Rhino.Geometry as rg
import scriptcontext as sc

if reset:

    PS = ks.PhysicalSystem()
    PS.ClearParticles()
    GoalList = List[ks.IGoal]()

    counter = 0

forceVec = rg.Vector3d(0,0, -z)

#remove last point from Polyline
for p in polylines:
    p.RemoveAt(p.Count - 1)

n0 = polylines[0].Count

tempCounter = counter % n0

poly = polylines[0][tempCounter]

PS.AddParticle(polylines[0][tempCounter], 0.001 ) #add this point to the particle system

#unary goal
GoalList.Add(ks.Goals.Unary(counter, forceVec ))

if(counter <n0):
    GoalList.Add(ks.Goals.Anchor (counter, PS.GetPosition(counter), 100000))


#create horizontal Springs
if counter != (counter/n0)  * tempCounter and counter != 0:
    GoalList.Add( ks.Goals.Spring(counter -1 , counter, 0 , 20 ))


#create vertical Springs
if counter > n0:
    GoalList.Add( ks.Goals.Spring(counter, counter - n0, 0 , 10 ))


counter +=1

PS.Step(GoalList, False, 0.001)

#expire the component (using the timer)
ghenv.Component.ExpireSolution(True)


A= PS.GetOutput(GoalList)
B= PS.GetPositions()
C = [poly]
# ---------- end python ----------
python_2 = GhPythonScript(xTree=series_2)  # -> out, a; inputs xTree: tree of Int32
# ---------- python_2: Python ----------
print xTree

tree= []

for i in range(xTree.BranchCount):
    branch= list( xTree.Branch(i)) #convert to python list
    tree.append(branch)

print tree
# ---------- end python_2 ----------
data = Data(python.A)
